# Grasshopper definition mobius.gh (Grasshopper 0.9.76)

number_slider = Slider(40, range=0..100)
pi = Pi(Factor=Slider(2, range=0..10))
cir = Circle(Plane=PlaneXY(0, 0, 0), Radius=Slider(8, range=0..10))
subtraction = Subtraction(A=number_slider, B=1)
division = Division(A=pi, B=3)
pframes = PerpFrames(Curve=cir, Count=number_slider, Align=True)  # -> Frames, Parameters
polygon = Polygon(Plane=pframes.Frames, Radius=Slider(5, range=0..10), Segments=Slider(3, range=0..10), FilletRadius=0)  # -> Polygon, Length
range = Range(Domain=division, Steps=subtraction)
division_2 = Division(A=number_slider, B=2)
panel = Panel(range)
fillet = Fillet(Curve=polygon.Polygon, Radius=Slider(0.9, range=0..1))
rotate = Rotate(Geometry=fillet, Angle=range, Plane=pframes.Frames)  # -> Geometry, Transform
dom = ConstructDomain(DomainStart=0, DomainEnd=division_2)
dom_2 = ConstructDomain(DomainStart=division_2, DomainEnd=subtraction)
subset = SubList(List=rotate.Geometry, Domain=dom, Wrap=True)  # -> List, Index
subset_2 = SubList(List=rotate.Geometry, Domain=dom_2, Wrap=True)  # -> List, Index
item = ListItem(List=pframes.Frames, Index=0, Wrap=True)
item_2 = ListItem(List=rotate.Geometry, Index=0, Wrap=True)
loft = Loft(Curves=subset.List, Options={Adjust=False, Closed=False, LoftEnds=0, LoftSimp=0, LoftType=0, Rebuild=10, Refit=0.01})
rotate_2 = Rotate(Geometry=item_2, Angle=division, Plane=item)  # -> Geometry, Transform
merge = Merge(Data1=flatten(subset_2.List), Data2=flatten(rotate_2.Geometry))
loft_2 = Loft(Curves=merge, Options={Adjust=False, Closed=False, LoftEnds=0, LoftSimp=0, LoftType=0, Rebuild=10, Refit=0.01})
panel_2 = Panel(subset_2.List)
join = BrepJoin(Breps=loft)  # -> Breps, Closed
join_2 = BrepJoin(Breps=loft_2)  # -> Breps, Closed
