# Grasshopper definition voronois.gh (Grasshopper 0.9.76)

number_slider = Slider(20, range=0..100)
number_slider_2 = Slider(5, range=0..20)
multiplication = Multiplication(A=number_slider, B=number_slider_2)
sqgrid = Square(Plane=PlaneXY(0, 0, 0), Size=1, ExtentX=number_slider, ExtentY=number_slider_2)  # -> Cells, Points
pt = ConstructPoint(XCoordinate=0, YCoordinate=0, ZCoordinate=0)
X = UnitX(Factor=number_slider)
division = Division(A=Slider(0.773, range=0..1), B=multiplication)
area = Area(Geometry=sqgrid.Cells)  # -> Area, Centroid
series = Series(Start=0, Step=division, Count=multiplication)
Y = UnitY(Factor=number_slider_2)
flatten = FlattenTree(Tree=area.Centroid, Path="{0}")
move = Move(Geometry=pt, Motion=X)  # -> Geometry, Transform
jitter = Jitter(List=series, Jitter=1, Seed=2)  # -> Values, Indices
jitter_2 = Jitter(List=jitter.Values, Jitter=1, Seed=2)  # -> Values, Indices
move_2 = Move(Geometry=move.Geometry, Motion=Y)  # -> Geometry, Transform
Y_2 = UnitY(Factor=jitter.Values)
move_3 = Move(Geometry=flatten, Motion=Y_2)  # -> Geometry, Transform
X_2 = UnitX(Factor=jitter_2.Values)
box = Box2Pt(PointA=pt, PointB=move_2.Geometry, Plane=PlaneXY(0, 0, 0))
move_4 = Move(Geometry=move_3.Geometry, Motion=X_2)  # -> Geometry, Transform
voronoi = Voronoi(Points=move_4.Geometry, Boundary=box, BruteForceOverride=False)
Y_3 = UnitY(Factor=number_slider_2)
X_3 = UnitX(Factor=number_slider)
debrep = DeconstructBrep(Brep=box)  # -> Faces, Edges, Vertices
divide = DivideCurve(Curve=voronoi, Count=Slider(5, range=0..10), Kinks=False)  # -> Points, Tangents, Parameters
move_5 = Move(Motion=Vector(0, 0, 10))  # -> Geometry, Transform
move_6 = Move(Motion=X_3)  # -> Geometry, Transform
join = JoinCurves(Curves=debrep.Edges, Preserve=False)
nurbs = NurbsCurve(Vertices=divide.Points, Degree=3, Periodic=True)  # -> Curve, Length, Domain
neg = Negative(Value=Slider(0.02, range=0..0.5))
offset = Offset(Curve=nurbs.Curve, Distance=neg, Plane=PlaneXY(0, 0, 0), Corners=1)
flatten_2 = FlattenTree(Tree=join, Path="{0}")
flatten_3 = FlattenTree(Tree=offset, Path="{0}")
boundary = BoundarySurfaces(Edges=[flatten_3, flatten_2])
panel = Panel(boundary)
